# Dynamo graph BIMACON_Deleta backup Famílias_R00_script.dyn "BIMACON_Deleta backup Famílias_script" (Dynamo 2.6.1.8786)
# packages: Data-Shapes 2022.2.105, Orchid 2.6.10.6373

# group: ENTRADAS PARA O USUÁRIO
code_block = CodeBlock()  # //archilab
code_block_2 = CodeBlock()  # //Data-Shapes
code_block_3 = CodeBlock { "Exluir Backups de Famílias"; }
file_path = Filename("..\..\..\..\..\05 - BIMACON\01 - EMPRESA BIMACON\00 - Logos e imagens - BIMACON\ARTE BIMACON\reddonda-removebg-preview.png")
file_from_path = FileObject(path=file_path)
readFromFile = Image.ReadFromFile(file=file_from_path)
string = StringInput("Confirmar")
string_2 = StringInput("D:\OneDrive\00 - TUDO REVIT")
string_3 = StringInput("Selecione a pasta")
directorypath_data = Custom[DirectoryPath Data](DefaultPath=string_2, ButtonText=string_3)  # package Data-Shapes; Creates a DirectoryPath input for UI.MultipleInputForm ++ . Check out www.data-shapes.net for more infos!
list_create = List.Create(item0=directorypath_data)
boolean = BoolSelector(true)
string_4 = StringInput("Cancelar")
number = DoubleInput(480)
number_2 = DoubleInput(210)
multipleinputform = Custom[MultipleInputForm ++](Description_optional=code_block_3, Logo_optional=readFromFile, ButtonText_optional=string, Inputs=list_create, Toggle=boolean, CancelButtonText_optional=string_4, Width_optional=number, LabelWidth_optional=number_2)  # package Data-Shapes; Create a form with multiple inputs. see www.data-shapes.net for tutorials and infos!

# group: Separar Entradas
code_block_4 = CodeBlock { 0; }
getItemAtIndex = List.GetItemAtIndex(list=multipleinputform.User_Inputs, index=code_block_4)

python_script = Python(IN[0]=getItemAtIndex)  # graph output
# ---------- python_script.python (18 lines) ----------
import sys
sys.path.append(r"C:\Program Files (x86)\IronPython 2.7\Lib")

import os
import re


filelist = list()
for root, dirs, files in os.walk(IN[0]):
	for file in files:
		matches = re.match(".*\.[0-9]+\.(rfa|RFA)$", file)
	
		if matches:
			backup = os.path.join(root, file)
			filelist.append(backup)
			os.remove(backup)

OUT = filelist
# ----------------------------------------

# group: mensagem
count = List.Count(list=python_script)
code_block_5 = CodeBlock { 0; }
gt = count > code_block_5
code_block_6 = CodeBlock(N=count) { ["Feito! você excluiu "+N+" backups"]; }
code_block_7 = CodeBlock { ["Nenhum backup foi excluído"]; }
if_ = If(test=gt, true=code_block_6, false=code_block_7)
o_string_fromlist = Orchid.Common.String.FromList(list=if_)
python_script_2 = Python(IN[0]=o_string_fromlist)
# ---------- python_script_2.python (21 lines) ----------
# Importar as bibliotecas necessárias do Revit
import clr
clr.AddReference("RevitServices")
from RevitServices.Persistence import DocumentManager

clr.AddReference("RevitAPI")
clr.AddReference("RevitAPIUI")
from Autodesk.Revit.UI import TaskDialog

# Pegar a entrada do Dynamo
mensagem = IN[0]

# Criar a TaskDialog
task_dialog = TaskDialog("Ok")
task_dialog.MainInstruction = mensagem

# Exibir a TaskDialog
task_dialog.Show()

# Saída do script
OUT = "Sucesso!"
# ----------------------------------------
