# Dynamo graph BIMACON_Deleta backup Famílias_R01_script.dyn "BIMACON_Deleta backup Famílias_R00_script" (Dynamo 3.2.1.5366)
# packages: Data-Shapes 2022.2.105

# group: ENTRADAS PARA O USUÁRIO
code_block = CodeBlock()  # //archilab
code_block_2 = CodeBlock()  # //Data-Shapes
code_block_3 = CodeBlock { "Exluir Backups de Famílias"; }
file_path = Filename("..\..\..\..\..\05 - BIMACON\01 - EMPRESA BIMACON\00 - Logos e imagens - BIMACON\ARTE BIMACON\reddonda-removebg-preview.png")
file_from_path = FileObject(path=file_path)
readFromFile = Image.ReadFromFile(file=file_from_path)
string = StringInput("Confirmar")
string_2 = StringInput("D:\OneDrive\00 - TUDO REVIT")
string_3 = StringInput("Selecione a pasta")
directorypath_data = Custom[DirectoryPath Data](DefaultPath=string_2, ButtonText=string_3)  # package Data-Shapes; Creates a DirectoryPath input for UI.MultipleInputForm ++ . Check out www.data-shapes.net for more infos!
list_create = List.Create(item0=directorypath_data)
boolean = BoolSelector(true)
string_4 = StringInput("Cancelar")
number = DoubleInput(480)
number_2 = DoubleInput(210)
multipleinputform = Custom[MultipleInputForm ++](Description_optional=code_block_3, Logo_optional=readFromFile, ButtonText_optional=string, Inputs=list_create, Toggle=boolean, CancelButtonText_optional=string_4, Width_optional=number, LabelWidth_optional=number_2)  # package Data-Shapes; Create a form with multiple inputs. see www.data-shapes.net for tutorials and infos!

# group: Separar Entradas
code_block_4 = CodeBlock { 0; }
getItemAtIndex = List.GetItemAtIndex(list=multipleinputform.User_Inputs, index=code_block_4)

python_script = Python(IN[0]=getItemAtIndex)  # IronPython3; graph output
# ---------- python_script.python (18 lines) ----------
import sys
sys.path.append(r"C:\Program Files (x86)\IronPython 2.7\Lib")

import os
import re


filelist = list()
for root, dirs, files in os.walk(IN[0]):
	for file in files:
		matches = re.match(".*\.[0-9]+\.(rfa|RFA)$", file)
	
		if matches:
			backup = os.path.join(root, file)
			filelist.append(backup)
			os.remove(backup)

OUT = filelist
# ----------------------------------------

# group: mensagem
count = List.Count(list=python_script)
code_block_5 = CodeBlock { 0; }
gt = count > code_block_5
code_block_6 = CodeBlock(N=count) { ["Feito! você excluiu "+N+" backups"]; }
code_block_7 = CodeBlock { ["Nenhum backup foi excluído"]; }
if_ = If(test=gt, true=code_block_6, false=code_block_7)
string_fromlist_bimacon = Python(IN[0]=if_)  # IronPython2
# ---------- string_fromlist_bimacon.python (22 lines) ----------
# Carregar as bibliotecas DesignScript e padrão do Python
import sys
import clr
clr.AddReference('ProtoGeometry')
from Autodesk.DesignScript.Geometry import *

# Função para concatenar os valores de uma lista em uma única string com múltiplas linhas
def concatenate_list_to_string(input_list, delimiter="\n"):
    # Verifica se a entrada é uma lista
    if not isinstance(input_list, list):
        return "A entrada deve ser uma lista."
    
    # Converte todos os elementos para string e junta com o delimitador especificado
    result = delimiter.join(str(item) for item in input_list)
    return result

# Entrada pelo nó do Dynamo
lista = IN[0]  # Lista de valores a serem concatenados
delimitador = IN[1] if len(IN) > 1 else "\n"  # Delimitador opcional, padrão é nova linha

# Saída para o Dynamo
OUT = concatenate_list_to_string(lista, delimitador)
# ----------------------------------------
python_script_2 = Python(IN[0]=string_fromlist_bimacon)  # IronPython2
# ---------- python_script_2.python (21 lines) ----------
# Importar as bibliotecas necessárias do Revit
import clr
clr.AddReference("RevitServices")
from RevitServices.Persistence import DocumentManager

clr.AddReference("RevitAPI")
clr.AddReference("RevitAPIUI")
from Autodesk.Revit.UI import TaskDialog

# Pegar a entrada do Dynamo
mensagem = IN[0]

# Criar a TaskDialog
task_dialog = TaskDialog("Ok")
task_dialog.MainInstruction = mensagem

# Exibir a TaskDialog
task_dialog.Show()

# Saída do script
OUT = "Sucesso!"
# ----------------------------------------
