# Dynamo graph BIMACON_Deleta backup Rotinas_R00_script.dyn "BIMACON_Deleta backup Rotinas_script" (Dynamo 2.6.1.8786)
# packages: Sastrugi 2.0.2, Data-Shapes 2022.2.105, Orchid 2.6.10.6373

code_block = CodeBlock()  # //Data-Shapes
code_block_2 = CodeBlock()  # //archilab
code_block_3 = CodeBlock { "Exluir Backups de Rotinas"; }
file_path = Filename("..\..\..\..\..\05 - BIMACON\01 - EMPRESA BIMACON\00 - Logos e imagens - BIMACON\ARTE BIMACON\reddonda-removebg-preview.png")
file_from_path = FileObject(path=file_path)
readFromFile = Image.ReadFromFile(file=file_from_path)
string = StringInput("Confirmar")
string_2 = StringInput("D:\OneDrive\00 - TUDO REVIT")
string_3 = StringInput("Selecione a pasta")
directorypath_data = Custom[DirectoryPath Data](DefaultPath=string_2, ButtonText=string_3)  # package Data-Shapes; Creates a DirectoryPath input for UI.MultipleInputForm ++ . Check out www.data-shapes.net for more infos!
list_create = List.Create(item0=directorypath_data)
boolean = BoolSelector(true)
string_4 = StringInput("Cancelar")
number = DoubleInput(480)
number_2 = DoubleInput(210)
multipleinputform = Custom[MultipleInputForm ++](Description_optional=code_block_3, Logo_optional=readFromFile, ButtonText_optional=string, Inputs=list_create, Toggle=boolean, CancelButtonText_optional=string_4, MaxHeight_optional=number, Width_optional=number_2)  # package Data-Shapes; Create a form with multiple inputs. see www.data-shapes.net for tutorials and infos!
code_block_4 = CodeBlock { 0; }
getItemAtIndex = List.GetItemAtIndex(list=multipleinputform.User_Inputs, index=code_block_4)
delete_dyn_and_dyf_backup_files = Custom[❄_Delete DYN and DYF Backup Files](DirectoryPath=getItemAtIndex)  # package Sastrugi; (Sastrugi_Management) This node deletes backup files created for Nodes and Scripts, from the specified directory.

# group: mensagem
count = List.Count(list=delete_dyn_and_dyf_backup_files)
code_block_5 = CodeBlock { 0; }
gt = count > code_block_5
code_block_6 = CodeBlock(N=count) { ["Feito! você excluiu "+N+" backups"]; }
code_block_7 = CodeBlock { ["Nenhum backup foi excluído"]; }
if_ = If(test=gt, true=code_block_6, false=code_block_7)
o_string_fromlist = Orchid.Common.String.FromList(list=if_)
python_script = Python(IN[0]=o_string_fromlist)
# ---------- python_script.python (21 lines) ----------
# Importar as bibliotecas necessárias do Revit
import clr
clr.AddReference("RevitServices")
from RevitServices.Persistence import DocumentManager

clr.AddReference("RevitAPI")
clr.AddReference("RevitAPIUI")
from Autodesk.Revit.UI import TaskDialog

# Pegar a entrada do Dynamo
mensagem = IN[0]

# Criar a TaskDialog
task_dialog = TaskDialog("Ok")
task_dialog.MainInstruction = mensagem

# Exibir a TaskDialog
task_dialog.Show()

# Saída do script
OUT = "Sucesso!"
# ----------------------------------------
