# Dynamo graph 2021_14-0_BIMACON_Deletar Conduítes Vazios-Lista Materiais_R00_script.dyn (Dynamo 2.6.1.8786)
# packages: DynaMEP 2.0.1, archi-lab.net 2023.213.1722

current = RevitModel.Documents.Current()
categories = Categories("OST_ConduitRun")  # graph input
selectByCategory = RevitModel.Element.SelectByCategory(doc=current, category=categories)
string = StringInput("Comprimento")
getParameterValueByName = Element.GetParameterValueByName(element=selectByCategory, parameterName=string)
number = DoubleInput(0)
eq = getParameterValueByName == number
filterByBoolMask = List.FilterByBoolMask(list=selectByCategory, mask=eq)
delete = archilab.Revit.Elements.Elements.Delete(element=filterByBoolMask.in)
watch = Watch(delete)

# group: Mensagem final
countTrue = List.CountTrue(list=watch)
code_block = CodeBlock { 0; }
gt = countTrue > code_block
code_block_2 = CodeBlock(N=countTrue) { ["Feito! Você Excluíu "+N+" direções de conduítes"]; }
code_block_3 = CodeBlock { ["Nenhum elemento foi Excluído"]; }
if_ = If(test=gt, true=code_block_2, false=code_block_3)

string_fromlist_bimacon = Python(IN[0]=if_)
# ---------- string_fromlist_bimacon.python (22 lines) ----------
# Carregar as bibliotecas DesignScript e padrão do Python
import sys
import clr
clr.AddReference('ProtoGeometry')
from Autodesk.DesignScript.Geometry import *

# Função para concatenar os valores de uma lista em uma única string com múltiplas linhas
def concatenate_list_to_string(input_list, delimiter="\n"):
    # Verifica se a entrada é uma lista
    if not isinstance(input_list, list):
        return "A entrada deve ser uma lista."
    
    # Converte todos os elementos para string e junta com o delimitador especificado
    result = delimiter.join(str(item) for item in input_list)
    return result

# Entrada pelo nó do Dynamo
lista = IN[0]  # Lista de valores a serem concatenados
delimitador = IN[1] if len(IN) > 1 else "\n"  # Delimitador opcional, padrão é nova linha

# Saída para o Dynamo
OUT = concatenate_list_to_string(lista, delimitador)
# ----------------------------------------
python_script = Python(IN[0]=string_fromlist_bimacon)
# ---------- python_script.python (21 lines) ----------
# Importar as bibliotecas necessárias do Revit
import clr
clr.AddReference("RevitServices")
from RevitServices.Persistence import DocumentManager

clr.AddReference("RevitAPI")
clr.AddReference("RevitAPIUI")
from Autodesk.Revit.UI import TaskDialog

# Pegar a entrada do Dynamo
mensagem = IN[0]

# Criar a TaskDialog
task_dialog = TaskDialog("Ok")
task_dialog.MainInstruction = mensagem

# Exibir a TaskDialog
task_dialog.Show()

# Saída do script
OUT = "Sucesso!"
# ----------------------------------------
