# Dynamo graph 2021_14-1_BIMACON_Deletar Eletrodutos Duplicados_script.dyn (Dynamo 2.6.1.8786)
# packages: Clockwork for Dynamo 2.x 2.4.0, DynaMEP 2.0.1

directory_path = Directory("No file selected.")
code_block = CodeBlock { "Sheet1"; }
code_block_2 = CodeBlock { 0; }
categories = Categories("OST_Conduit")
categories_2 = Categories("OST_CableTray")
list_create = List.Create(item0=categories, item1=categories_2)
all_elements_of_category = ElementsOfCategory(Category=list_create)
flatten = List.Flatten(list=all_elements_of_category)
location = Custom[Element.Location+](element=flatten)  # package Clockwork for Dynamo 2.x; Returns the location of an element as point, curve or curve loop, along with some booleans to help filtering the results. Unlike the OOTB Element.GetLocation node, it also retunrs sketch lines of sketch-based elements like floor slabs as well as the element's rotation property.
code_block_3 = CodeBlock { 0; 1; }
getItemAtIndex = List.GetItemAtIndex(list=location.curveEndpoints@L2, index=code_block_3.out0)
getItemAtIndex_2 = List.GetItemAtIndex(list=location.curveEndpoints@L2, index=code_block_3.out1)
midpoint = Geometry.Points.Midpoint(startPoint=getItemAtIndex, endPoint=getItemAtIndex_2)
python_scripts = Python(IN[0]=midpoint)
# ---------- python_scripts.python (41 lines) ----------
import clr
clr.AddReference('ProtoGeometry')
from Autodesk.DesignScript.Geometry import *

# Import DocumentManager and TransactionManager
clr.AddReference("RevitServices")
import RevitServices
from RevitServices.Persistence import DocumentManager
from RevitServices.Transactions import TransactionManager

# Import RevitAPI
clr.AddReference("RevitAPI")
import Autodesk
from Autodesk.Revit.DB import *

doc = DocumentManager.Instance.CurrentDBDocument
uiapp = DocumentManager.Instance.CurrentUIApplication
app = uiapp.Application

from System.Collections.Generic import *

# Import ToDSType(bool) extension method
clr.AddReference("RevitNodes")
import Revit
clr.ImportExtensions(Revit.Elements)

#The inputs to this node will be stored as a list in the IN variable.
dataEnteringNode = IN
mylist = IN[0]

i, seen, result = mylist, set(), []
for _index, item in enumerate(i):
    if item not in seen:
		# First time seeing the element
        seen.add(item)
    else:
		 # Already seen, add the index to the result
        result.append(_index)     

#Assign your output to the OUT variable
OUT = result
# ----------------------------------------
getItemAtIndex_3 = List.GetItemAtIndex(list=flatten, index=python_scripts)
flatten_2 = List.Flatten(list=getItemAtIndex_3)
id = Element.Id(element=getItemAtIndex_3)
transpose = List.Transpose(lists=id)
list_create_2 = List.Create(item0=flatten_2, item1=transpose)
boolean = BoolSelector(true)
exportExcel = Data.ExportExcel(filePath=directory_path, sheetName=code_block, startRow=code_block_2, startCol=code_block_2, data=list_create_2, overWrite=boolean)
delete = Python(IN[0]=getItemAtIndex_3)  # "Element.Delete"
# ---------- delete.python (46 lines) ----------
import clr
clr.AddReference('ProtoGeometry')
from Autodesk.DesignScript.Geometry import *

# Import DocumentManager and TransactionManager
clr.AddReference("RevitServices")
import RevitServices
from RevitServices.Persistence import DocumentManager
from RevitServices.Transactions import TransactionManager

# Import RevitAPI
clr.AddReference("RevitAPI")
import Autodesk
from Autodesk.Revit.DB import *

doc = DocumentManager.Instance.CurrentDBDocument
uiapp = DocumentManager.Instance.CurrentUIApplication
app = uiapp.Application

from System.Collections.Generic import *

#The inputs to this node will be stored as a list in the IN variable.
dataEnteringNode = IN

elements = IN[0]

def toRvtId(_id):
	if isinstance(_id, int) or isinstance(_id, str):
		id = ElementId(int(_id))
		return id
	elif isinstance(_id, ElementId):
		return _id

#"Start" the transaction
TransactionManager.Instance.EnsureInTransaction(doc)

results = []
for i in elements:
	doc.Delete(toRvtId(i.Id))
	results.append("Family ID" + i.Id.ToString() + " was deleted.")

# "End" the transaction
TransactionManager.Instance.TransactionTaskDone()

#Assign your output to the OUT variable
OUT = results
# ----------------------------------------

# group: Mensagem
count = List.Count(list=delete)
code_block_4 = CodeBlock { 0; }
gt = count > code_block_4
code_block_5 = CodeBlock(N=count) { ["Planilha gerada! Você deletou "+N+" elementos duplicados em seu projeto"]; }
code_block_6 = CodeBlock { ["Nenhum elemento foi deletado, verifique na Planilha gerada"]; }
if_ = If(test=gt, true=code_block_5, false=code_block_6)

string_fromlist_bimacon = Python(IN[0]=if_)
# ---------- string_fromlist_bimacon.python (22 lines) ----------
# Carregar as bibliotecas DesignScript e padrão do Python
import sys
import clr
clr.AddReference('ProtoGeometry')
from Autodesk.DesignScript.Geometry import *

# Função para concatenar os valores de uma lista em uma única string com múltiplas linhas
def concatenate_list_to_string(input_list, delimiter="\n"):
    # Verifica se a entrada é uma lista
    if not isinstance(input_list, list):
        return "A entrada deve ser uma lista."
    
    # Converte todos os elementos para string e junta com o delimitador especificado
    result = delimiter.join(str(item) for item in input_list)
    return result

# Entrada pelo nó do Dynamo
lista = IN[0]  # Lista de valores a serem concatenados
delimitador = IN[1] if len(IN) > 1 else "\n"  # Delimitador opcional, padrão é nova linha

# Saída para o Dynamo
OUT = concatenate_list_to_string(lista, delimitador)
# ----------------------------------------

# group (continued): Mensagem
python_script = Python(IN[0]=string_fromlist_bimacon)
# ---------- python_script.python (21 lines) ----------
# Importar as bibliotecas necessárias do Revit
import clr
clr.AddReference("RevitServices")
from RevitServices.Persistence import DocumentManager

clr.AddReference("RevitAPI")
clr.AddReference("RevitAPIUI")
from Autodesk.Revit.UI import TaskDialog

# Pegar a entrada do Dynamo
mensagem = IN[0]

# Criar a TaskDialog
task_dialog = TaskDialog("Ok")
task_dialog.MainInstruction = mensagem

# Exibir a TaskDialog
task_dialog.Show()

# Saída do script
OUT = "Sucesso!"
# ----------------------------------------
