# Dynamo graph BIMACON_Deleta Familias com extensão 1_R00_script.dyn (Dynamo 2.6.1.8786)
# packages: archi-lab.net 2023.213.1722, Data-Shapes 2022.2.105

element_types = ElementTypes("Family")
all_elements_of_type = ElementsOfType(element_type=element_types)
flatten = List.Flatten(list=all_elements_of_type)
uniqueItems = List.UniqueItems(list=flatten)
name = Family.Name(family=uniqueItems)
sort = List.Sort(list=name)
byName = Family.ByName(name=sort)
code_block = CodeBlock { "1"; }
endsWith = String.EndsWith(str=sort, searchFor=code_block)
filterByBoolMask = List.FilterByBoolMask(list=byName, mask=endsWith)
name_2 = Family.Name(family=filterByBoolMask.in)
code_block_2 = CodeBlock { "01"; }
endsWith_2 = String.EndsWith(str=name_2, searchFor=code_block_2)
filterByBoolMask_2 = List.FilterByBoolMask(list=filterByBoolMask.in, mask=endsWith_2)
name_3 = Family.Name(family=filterByBoolMask_2.out)
code_block_3 = CodeBlock { " 1"; }
endsWith_3 = String.EndsWith(str=name_3, searchFor=code_block_3)
filterByBoolMask_3 = List.FilterByBoolMask(list=filterByBoolMask_2.out, mask=endsWith_3)
name_4 = Family.Name(family=filterByBoolMask_3.out)
length = String.Length(str=name_4)
code_block_4 = CodeBlock { 1; "1"; }
sub = length - code_block_4.out0
remove = String.Remove(str=name_4, startIndex=sub, count=code_block_4.out0)
byName_2 = Family.ByName(name=remove)
list_create = List.Create(item0=byName_2, item1=filterByBoolMask_3.out)
flatten_2 = List.Flatten(list=list_create)
boolean = BoolSelector(false)
clean = List.Clean(list=flatten_2, preserveIndices=boolean)
name_5 = Family.Name(family=clean)

# group: SELECIONE O MODELO ARQ LINKADO
code_block_5 = CodeBlock { "Selecione as famílias a serem deletadas"; }
file_path = Filename("..\..\..\..\..\05 - BIMACON\01 - EMPRESA BIMACON\00 - Logos e imagens - BIMACON\ARTE BIMACON\reddonda-removebg-preview.png")
file_from_path = FileObject(path=file_path)
readFromFile = Image.ReadFromFile(file=file_from_path)
string = StringInput("Confirmar")
boolean_2 = BoolSelector(false)
listview_data = Custom[Listview Data](Keys=name_5, Values=clean, ShowId_optionnal=boolean_2)  # package Data-Shapes; Create data for ListView input in UI.MultiInputForm ++ . Check out www.data-shapes.net for more infos.
list_create_2 = List.Create(item0=listview_data)
boolean_3 = BoolSelector(true)
string_2 = StringInput("Cancelar")
code_block_6 = CodeBlock { 600; }
multipleinputform = Custom[MultipleInputForm ++](Description_optional=code_block_5, Logo_optional=readFromFile, ButtonText_optional=string, Inputs=list_create_2, Toggle=boolean_3, CancelButtonText_optional=string_2, Width_optional=code_block_6)  # package Data-Shapes; Create a form with multiple inputs. see www.data-shapes.net for tutorials and infos!
code_block_7 = CodeBlock()  # //Data-Shapes
code_block_8 = CodeBlock()  # //archilab

code_block_9 = CodeBlock { 0; }
getItemAtIndex = List.GetItemAtIndex(list=multipleinputform.User_Inputs, index=code_block_9)
delete = archilab.Revit.Elements.Elements.Delete(element=getItemAtIndex)

# group: Mensagem Final
countTrue = List.CountTrue(list=delete)
code_block_10 = CodeBlock { 0; }
gt = countTrue > code_block_10
code_block_11 = CodeBlock(N=countTrue) { [""+N+" elementos foram deletados"]; }
code_block_12 = CodeBlock { ["Nenhum elemento deletado"]; }
if_ = If(test=gt, true=code_block_11, false=code_block_12)
flatten_3 = List.Flatten(list=if_)

string_fromlist_bimacon = Python(IN[0]=flatten_3)
# ---------- string_fromlist_bimacon.python (22 lines) ----------
# Carregar as bibliotecas DesignScript e padrão do Python
import sys
import clr
clr.AddReference('ProtoGeometry')
from Autodesk.DesignScript.Geometry import *

# Função para concatenar os valores de uma lista em uma única string com múltiplas linhas
def concatenate_list_to_string(input_list, delimiter="\n"):
    # Verifica se a entrada é uma lista
    if not isinstance(input_list, list):
        return "A entrada deve ser uma lista."
    
    # Converte todos os elementos para string e junta com o delimitador especificado
    result = delimiter.join(str(item) for item in input_list)
    return result

# Entrada pelo nó do Dynamo
lista = IN[0]  # Lista de valores a serem concatenados
delimitador = IN[1] if len(IN) > 1 else "\n"  # Delimitador opcional, padrão é nova linha

# Saída para o Dynamo
OUT = concatenate_list_to_string(lista, delimitador)
# ----------------------------------------

# group (continued): Mensagem Final
python_script = Python(IN[0]=string_fromlist_bimacon)
# ---------- python_script.python (21 lines) ----------
# Importar as bibliotecas necessárias do Revit
import clr
clr.AddReference("RevitServices")
from RevitServices.Persistence import DocumentManager

clr.AddReference("RevitAPI")
clr.AddReference("RevitAPIUI")
from Autodesk.Revit.UI import TaskDialog

# Pegar a entrada do Dynamo
mensagem = IN[0]

# Criar a TaskDialog
task_dialog = TaskDialog("Ok")
task_dialog.MainInstruction = mensagem

# Exibir a TaskDialog
task_dialog.Show()

# Saída do script
OUT = "Sucesso!"
# ----------------------------------------
