# Dynamo graph BIMACON_Deletar Elementos Duplicados_R00_script.dyn (Dynamo 2.6.1.8786)
# packages: Crumple 2021.9.24

# note: Custom Node: Crumple v.2021.9.24
getwarnings = Custom[© GetWarnings]()  # package Crumple; Returns all warnings in the Revit model in their Revit db format.
warningmessage = Custom[© WarningMessage](warning=getwarnings)  # package Crumple; Given a warning element in Revit db format, will return the message associated with that warning in a generic string format.
code_block = CodeBlock { "instâncias idênticas"; true; }
contains = String.Contains(str=warningmessage, searchFor=code_block.out0, ignoreCase=code_block.out1)
filterByBoolMask = List.FilterByBoolMask(list=getwarnings, mask=contains)
warningelements = Custom[© WarningElements](warning=filterByBoolMask.in)  # package Crumple; Returns the element(s) associated with the provided warning.
code_block_2 = CodeBlock { 0; }
removeItemAtIndex = List.RemoveItemAtIndex(list=warningelements@L2, indices=code_block_2)
flatten = List.Flatten(list=removeItemAtIndex)
uniqueItems = List.UniqueItems(list=flatten)
elementdelete = Custom[© ElementDelete](elements=uniqueItems)  # package Crumple; Given a list of elements, attempt to delete them and then return true or false depending on whether it could be deleted. This script flattens the list structure before attempting.

# group: Mensagem
count = List.Count(list=elementdelete.results)
code_block_3 = CodeBlock { 0; }
gt = count > code_block_3
code_block_4 = CodeBlock(N=count) { ["Feito! Você deletou "+N+" elementos duplicados em seu projeto"]; }
code_block_5 = CodeBlock { ["Nenhum elemento foi deletado"]; }
if_ = If(test=gt, true=code_block_4, false=code_block_5)

string_fromlist_bimacon = Python(IN[0]=if_)
# ---------- string_fromlist_bimacon.python (22 lines) ----------
# Carregar as bibliotecas DesignScript e padrão do Python
import sys
import clr
clr.AddReference('ProtoGeometry')
from Autodesk.DesignScript.Geometry import *

# Função para concatenar os valores de uma lista em uma única string com múltiplas linhas
def concatenate_list_to_string(input_list, delimiter="\n"):
    # Verifica se a entrada é uma lista
    if not isinstance(input_list, list):
        return "A entrada deve ser uma lista."
    
    # Converte todos os elementos para string e junta com o delimitador especificado
    result = delimiter.join(str(item) for item in input_list)
    return result

# Entrada pelo nó do Dynamo
lista = IN[0]  # Lista de valores a serem concatenados
delimitador = IN[1] if len(IN) > 1 else "\n"  # Delimitador opcional, padrão é nova linha

# Saída para o Dynamo
OUT = concatenate_list_to_string(lista, delimitador)
# ----------------------------------------

# group (continued): Mensagem
python_script = Python(IN[0]=string_fromlist_bimacon)
# ---------- python_script.python (21 lines) ----------
# Importar as bibliotecas necessárias do Revit
import clr
clr.AddReference("RevitServices")
from RevitServices.Persistence import DocumentManager

clr.AddReference("RevitAPI")
clr.AddReference("RevitAPIUI")
from Autodesk.Revit.UI import TaskDialog

# Pegar a entrada do Dynamo
mensagem = IN[0]

# Criar a TaskDialog
task_dialog = TaskDialog("Ok")
task_dialog.MainInstruction = mensagem

# Exibir a TaskDialog
task_dialog.Show()

# Saída do script
OUT = "Sucesso!"
# ----------------------------------------
