# Dynamo graph BIMACON_Isolar Familias com extensão 1_R01_script.dyn (Dynamo 2.6.1.8786)
# packages: Clockwork for Dynamo 2.x 2.4.0, Crumple 2021.9.24

# group: Seloecionar elementos
element_types = ElementTypes("Family")
all_elements_of_type = ElementsOfType(element_type=element_types)
flatten = List.Flatten(list=all_elements_of_type)
uniqueItems = List.UniqueItems(list=flatten)
name = Family.Name(family=uniqueItems)
sort = List.Sort(list=name)
byName = Family.ByName(name=sort)
code_block = CodeBlock { "1"; }
endsWith = String.EndsWith(str=sort, searchFor=code_block)
filterByBoolMask = List.FilterByBoolMask(list=byName, mask=endsWith)

# group: Filtrar elementos de final 1
name_2 = Family.Name(family=filterByBoolMask.in)
code_block_2 = CodeBlock { "01"; }
endsWith_2 = String.EndsWith(str=name_2, searchFor=code_block_2)
filterByBoolMask_2 = List.FilterByBoolMask(list=filterByBoolMask.in, mask=endsWith_2)
name_3 = Family.Name(family=filterByBoolMask_2.out)
code_block_3 = CodeBlock { " 1"; }
endsWith_3 = String.EndsWith(str=name_3, searchFor=code_block_3)
filterByBoolMask_3 = List.FilterByBoolMask(list=filterByBoolMask_2.out, mask=endsWith_3)
name_4 = Family.Name(family=filterByBoolMask_3.out)
length = String.Length(str=name_4)
code_block_4 = CodeBlock { 1; "1"; }
sub = length - code_block_4.out0
remove = String.Remove(str=name_4, startIndex=sub, count=code_block_4.out0)
byName_2 = Family.ByName(name=remove)
list_create = List.Create(item0=byName_2, item1=filterByBoolMask_3.out)
flatten_2 = List.Flatten(list=list_create)
boolean = BoolSelector(false)
clean = List.Clean(list=flatten_2, preserveIndices=boolean)
name_5 = Family.Name(family=clean)

types = Family.Types(family=clean)
byFamilyType = FamilyInstance.ByFamilyType(familyType=types)
flatten_3 = List.Flatten(list=byFamilyType)
boolean_2 = BoolSelector(false)
clean_2 = List.Clean(list=flatten_3, preserveIndices=boolean_2)

# group: Nome da vista com qtd de elementos selecionados
count = List.Count(list=clean_2)
string = StringInput(" Elementos 3D")
add = count + string

# group: Criar Vista a partir de uma existente
views = Views("{3D}")
duplicate = Custom[View.Duplicate](view=views, name=add)  # package Clockwork for Dynamo 2.x; Duplicates a given view

# group: Ocultar/Exibir
flatten_4 = List.Flatten(list=clean_2)
temporarilyIsolateElement = Custom[View.TemporarilyIsolateElement](view=duplicate, element=flatten_4)  # package Clockwork for Dynamo 2.x; Temporarily isolates elements in the given view

# group: Mensagem Final
isNull = Object.IsNull(obj=temporarilyIsolateElement.view)
code_block_5 = CodeBlock { ["Nenhuma vista criada"]; }
name_6 = Element.Name(element=temporarilyIsolateElement.view)
code_block_6 = CodeBlock(N=name_6) { ["A vista "+N+" foi criada"]; }
if_ = If(test=isNull, true=code_block_5, false=code_block_6)
flatten_5 = List.Flatten(list=if_)

string_fromlist_bimacon = Python(IN[0]=flatten_5)
# ---------- string_fromlist_bimacon.python (22 lines) ----------
# Carregar as bibliotecas DesignScript e padrão do Python
import sys
import clr
clr.AddReference('ProtoGeometry')
from Autodesk.DesignScript.Geometry import *

# Função para concatenar os valores de uma lista em uma única string com múltiplas linhas
def concatenate_list_to_string(input_list, delimiter="\n"):
    # Verifica se a entrada é uma lista
    if not isinstance(input_list, list):
        return "A entrada deve ser uma lista."
    
    # Converte todos os elementos para string e junta com o delimitador especificado
    result = delimiter.join(str(item) for item in input_list)
    return result

# Entrada pelo nó do Dynamo
lista = IN[0]  # Lista de valores a serem concatenados
delimitador = IN[1] if len(IN) > 1 else "\n"  # Delimitador opcional, padrão é nova linha

# Saída para o Dynamo
OUT = concatenate_list_to_string(lista, delimitador)
# ----------------------------------------

# group (continued): Mensagem Final
python_script = Python(IN[0]=string_fromlist_bimacon)
# ---------- python_script.python (21 lines) ----------
# Importar as bibliotecas necessárias do Revit
import clr
clr.AddReference("RevitServices")
from RevitServices.Persistence import DocumentManager

clr.AddReference("RevitAPI")
clr.AddReference("RevitAPIUI")
from Autodesk.Revit.UI import TaskDialog

# Pegar a entrada do Dynamo
mensagem = IN[0]

# Criar a TaskDialog
task_dialog = TaskDialog("Ok")
task_dialog.MainInstruction = mensagem

# Exibir a TaskDialog
task_dialog.Show()

# Saída do script
OUT = "Sucesso!"
# ----------------------------------------

viewopen = Custom[© ViewOpen](view=temporarilyIsolateElement.view)  # package Crumple; Opens a Revit view (can also be a sheet).
