# Dynamo graph BIMACON_Deleta Elementos de Categorias no documento_script.dyn (Dynamo 2.6.1.8786)
# packages: DynaMEP 2.0.1, archi-lab.net 2023.213.1722, Data-Shapes 2022.2.105

# group: ENTRADAS PARA O USUÁRIO
code_block = CodeBlock()  # //Data-Shapes
code_block_2 = CodeBlock()  # //archilab
code_block_3 = CodeBlock { "Deletar todos Elementos de Uma Categoria"; }
file_path = Filename("..\..\..\..\..\05 - BIMACON\01 - EMPRESA BIMACON\00 - Logos e imagens - BIMACON\ARTE BIMACON\reddonda-removebg-preview.png")
file_from_path = FileObject(path=file_path)
readFromFile = Image.ReadFromFile(file=file_from_path)
string = StringInput("Confirmar")
string_2 = StringInput("Selecione categoria a ser deletada")
categories_list = Custom[Categories list]()  # package Data-Shapes; Gives list of all Revit categories and a matching list of their names
sort = List.Sort(list=categories_list.Category_name_s)
byName = Category.ByName(name=sort)
code_block_4 = CodeBlock { 54; }
dropdown_data = Custom[DropDown Data](InputName=string_2, Keys=sort, Values=byName, DefaultValueIndex=code_block_4)  # package Data-Shapes; Create data for DropDown input in UI.MultiInputForm ++ . Check out www.data-shapes.net for more infos.
list_create = List.Create(item0=dropdown_data)
boolean = BoolSelector(true)
string_3 = StringInput("Cancelar")
number = DoubleInput(480)
number_2 = DoubleInput(170)
multipleinputform = Custom[MultipleInputForm ++](Description_optional=code_block_3, Logo_optional=readFromFile, ButtonText_optional=string, Inputs=list_create, Toggle=boolean, CancelButtonText_optional=string_3, Width_optional=number, LabelWidth_optional=number_2)  # package Data-Shapes; Create a form with multiple inputs. see www.data-shapes.net for tutorials and infos!

current = RevitModel.Documents.Current()

# group: Separar Entradas
code_block_5 = CodeBlock { 0; }
getItemAtIndex = List.GetItemAtIndex(list=multipleinputform.User_Inputs, index=code_block_5)

selectByCategory = RevitModel.Element.SelectByCategory(doc=current, category=getItemAtIndex)
delete = archilab.Revit.Elements.Elements.Delete(element=selectByCategory)
countTrue = List.CountTrue(list=delete)

# group: Mensagem Final
code_block_6 = CodeBlock { 0; }
gt = countTrue > code_block_6
code_block_7 = CodeBlock(N=countTrue) { [""+N+" elementos foram deletados"]; }
code_block_8 = CodeBlock { ["Nenhum elemento deletado"]; }
if_ = If(test=gt, true=code_block_7, false=code_block_8)
flatten = List.Flatten(list=if_)

string_fromlist_bimacon = Python(IN[0]=flatten)
# ---------- string_fromlist_bimacon.python (22 lines) ----------
# Carregar as bibliotecas DesignScript e padrão do Python
import sys
import clr
clr.AddReference('ProtoGeometry')
from Autodesk.DesignScript.Geometry import *

# Função para concatenar os valores de uma lista em uma única string com múltiplas linhas
def concatenate_list_to_string(input_list, delimiter="\n"):
    # Verifica se a entrada é uma lista
    if not isinstance(input_list, list):
        return "A entrada deve ser uma lista."
    
    # Converte todos os elementos para string e junta com o delimitador especificado
    result = delimiter.join(str(item) for item in input_list)
    return result

# Entrada pelo nó do Dynamo
lista = IN[0]  # Lista de valores a serem concatenados
delimitador = IN[1] if len(IN) > 1 else "\n"  # Delimitador opcional, padrão é nova linha

# Saída para o Dynamo
OUT = concatenate_list_to_string(lista, delimitador)
# ----------------------------------------

# group (continued): Mensagem Final
python_script = Python(IN[0]=string_fromlist_bimacon)
# ---------- python_script.python (21 lines) ----------
# Importar as bibliotecas necessárias do Revit
import clr
clr.AddReference("RevitServices")
from RevitServices.Persistence import DocumentManager

clr.AddReference("RevitAPI")
clr.AddReference("RevitAPIUI")
from Autodesk.Revit.UI import TaskDialog

# Pegar a entrada do Dynamo
mensagem = IN[0]

# Criar a TaskDialog
task_dialog = TaskDialog("Ok")
task_dialog.MainInstruction = mensagem

# Exibir a TaskDialog
task_dialog.Show()

# Saída do script
OUT = "Sucesso!"
# ----------------------------------------
