# Dynamo graph BIMACON_Pisos acompanhando Topografia_RVT 2024_R00_script.dyn (Dynamo 2.6.1.8786)
# packages: Data-Shapes 2022.2.105

# group: ENTRADAS PARA O USUÁRIO
code_block = CodeBlock()  # //Data-Shapes
code_block_2 = CodeBlock()  # //archilab
code_block_3 = CodeBlock { "Ajuste do Piso à Superfície Topográfica"; }
file_path = Filename("..\..\..\..\..\05 - BIMACON\01 - EMPRESA BIMACON\00 - Logos e imagens - BIMACON\ARTE BIMACON\reddonda-removebg-preview.png")
file_from_path = FileObject(path=file_path)
readFromFile = Image.ReadFromFile(file=file_from_path)
string = StringInput("Confirmar")
string_2 = StringInput("Subregião (deverá ter o mesmo contorno do piso)")
string_3 = StringInput("Selecione ")
categories = Categories("OST_BuildingPad")
categories_2 = Categories("OST_Topography")
categories_3 = Categories("OST_Toposolid")
list_create = List.Create(item0=categories, item1=categories_2, item2=categories_3)
boolean = BoolSelector(true)
selectmodelelements_data = Custom[SelectModelElements Data](InputName=string_2, ButtonText=string_3, CategoryFilter=list_create, SelectSingleElement=boolean)  # package Data-Shapes; Creates a Revit element selection input for UI.MultipleInputForm++ . Check out www.data-shapes.net for more infos!
string_4 = StringInput("Piso à ser ajustado")
categories_4 = Categories("OST_Floors")
selectmodelelements_data_2 = Custom[SelectModelElements Data](InputName=string_4, ButtonText=string_3, CategoryFilter=categories_4, SelectSingleElement=boolean)
string_5 = StringInput("Offset do piso em relação à topografia")
string_6 = StringInput("0")
boolean_2 = BoolSelector(true)
textbox_data = Custom[TextBox Data](InputName=string_5, DefaultText=string_6, IsNumberEntry=boolean_2)  # package Data-Shapes; Create Data for TextBox input in UI.MultipleInputForm ++ . Check out www.data-shapes.net for more informations
list_create_2 = List.Create(item0=selectmodelelements_data, item1=selectmodelelements_data_2, item2=textbox_data)
boolean_3 = BoolSelector(true)
string_7 = StringInput("Cancelar")
number = DoubleInput(600)
number_2 = DoubleInput(190)
multipleinputform = Custom[MultipleInputForm ++](Description_optional=code_block_3, Logo_optional=readFromFile, ButtonText_optional=string, Inputs=list_create_2, Toggle=boolean_3, CancelButtonText_optional=string_7, Width_optional=number, LabelWidth_optional=number_2)  # package Data-Shapes; Create a form with multiple inputs. see www.data-shapes.net for tutorials and infos!

# group: Separar Entradas
code_block_4 = CodeBlock { 1; }
getItemAtIndex = List.GetItemAtIndex(list=multipleinputform.User_Inputs, index=code_block_4)
code_block_5 = CodeBlock { 0; }
getItemAtIndex_2 = List.GetItemAtIndex(list=multipleinputform.User_Inputs, index=code_block_5)
code_block_6 = CodeBlock { 2; }
getItemAtIndex_3 = List.GetItemAtIndex(list=multipleinputform.User_Inputs, index=code_block_6)

# group: Obter os pontos da Subregião sólida
faces = Element.Faces(element=getItemAtIndex_2)
perimeterCurves = Surface.PerimeterCurves(surface=faces)
intersect = Geometry.Intersect(geometry=perimeterCurves, other=perimeterCurves, lacing=CrossProduct)
flatten = List.Flatten(list=intersect)
code_block_7 = CodeBlock { "Autodesk.DesignScript.Geometry.Point"; }
removeIfNot = List.RemoveIfNot(list=flatten, type=code_block_7)
pruneDuplicates = Point.PruneDuplicates(points=removeIfNot)

# group: Agrupar pontos coincidentes com alturas diferentes
X = Point.X(point=pruneDuplicates)
code_block_8 = CodeBlock { 2; }
round = Math.Round(number=X, digits=code_block_8)
groupByKey = List.GroupByKey(list=pruneDuplicates@L2, keys=round@L2)

# group: Obter apenas os pontos inferiores
Z = Point.Z(point=groupByKey.groups)
sortByKey = List.SortByKey(list=groupByKey.groups@L2, keys=Z@L2)
firstItem = List.FirstItem(list=sortByKey.sorted_list@L2)

# group: Inserir o Offset para o Piso
X_2 = Point.X(point=firstItem)
Y = Point.Y(point=firstItem)
Z_2 = Point.Z(point=firstItem)
add = Z_2 + getItemAtIndex_3
byCoordinates = Point.ByCoordinates(x=X_2, y=Y, z=add)

# group: Inserir pontos no Piso
addPoint = Floor.AddPoint(floor=getItemAtIndex, point=byCoordinates)

# group: Mensagem Final
flatten_2 = List.Flatten(list=addPoint)
count = List.Count(list=flatten_2)
code_block_9 = CodeBlock { 0; }
gt = count > code_block_9
code_block_10 = CodeBlock { ["Feito! você anexou o piso junto a topografia"]; }
code_block_11 = CodeBlock { ["Nenhum Piso foi anexado a topografia"]; }
if_ = If(test=gt, true=code_block_10, false=code_block_11)
flatten_3 = List.Flatten(list=if_)

string_fromlist_bimacon = Python(IN[0]=flatten_3)
# ---------- string_fromlist_bimacon.python (22 lines) ----------
# Carregar as bibliotecas DesignScript e padrão do Python
import sys
import clr
clr.AddReference('ProtoGeometry')
from Autodesk.DesignScript.Geometry import *

# Função para concatenar os valores de uma lista em uma única string com múltiplas linhas
def concatenate_list_to_string(input_list, delimiter="\n"):
    # Verifica se a entrada é uma lista
    if not isinstance(input_list, list):
        return "A entrada deve ser uma lista."
    
    # Converte todos os elementos para string e junta com o delimitador especificado
    result = delimiter.join(str(item) for item in input_list)
    return result

# Entrada pelo nó do Dynamo
lista = IN[0]  # Lista de valores a serem concatenados
delimitador = IN[1] if len(IN) > 1 else "\n"  # Delimitador opcional, padrão é nova linha

# Saída para o Dynamo
OUT = concatenate_list_to_string(lista, delimitador)
# ----------------------------------------

# group (continued): Mensagem Final
python_script = Python(IN[0]=string_fromlist_bimacon)
# ---------- python_script.python (21 lines) ----------
# Importar as bibliotecas necessárias do Revit
import clr
clr.AddReference("RevitServices")
from RevitServices.Persistence import DocumentManager

clr.AddReference("RevitAPI")
clr.AddReference("RevitAPIUI")
from Autodesk.Revit.UI import TaskDialog

# Pegar a entrada do Dynamo
mensagem = IN[0]

# Criar a TaskDialog
task_dialog = TaskDialog("Ok")
task_dialog.MainInstruction = mensagem

# Exibir a TaskDialog
task_dialog.Show()

# Saída do script
OUT = "Sucesso!"
# ----------------------------------------
