# Dynamo graph BIMACON_Alinhar topografia ao piso selecionado_R00_script.dyn (Dynamo 2.6.1.8786)
# packages: Synthesize toolkit 12.5.1, Data-Shapes 2022.2.105

# group: Input
n01_select_topography = DSModelElementSelection()  # "01.Select Topography"; 1 picked in the model; graph input
n02_select_edges = SelectEdges()  # "02.Select Edges"; 9 picked in the model; graph input
# note: CATEGORIA:
# Documentação
# DESCRIÇÃO:
# Alinha uma topografia a um piso existente, selecionando as arestas. O processo é feito adicionando pontos de acordo com as linhas selecionadas
# ENTRADAS:
# •  Topografia
# •  Linhas do piso (edges)
# •  Altura de deslocamento da topografia a partir das linhas do piso
# •  Espaçamento entre pontos que serão adicionados
# •  Range de pontos próximos à serem limpos (suavização da topografia)
# OBSERVAÇÃO:
# - Não funciona no Revit 2024 por conta das alterações da topografia
# AUTOR:
# - Synthesize Toolkit
# VERSÕES TESTADAS DO REVIT
# •   2023 e 2022
# PACOTES NECESSÁRIOS:
# - Synthesize Toolkit
n03_height_offset_of_selected = DoubleInput(0)  # "03.Height Offset Of Selected Edges"; graph input
n04_spacing_between_points_to_add = DoubleInput(0.5)  # "04.Spacing Between Points To Add"; graph input
n05_nearby_points_cleaning_range = DoubleInput(1)  # "05.Nearby Points Cleaning Range"; graph input

debug_python = Custom[Debug Python]()  # package Synthesize toolkit; Debug Python

# group: ENTRADAS PARA O USUÁRIO
code_block = CodeBlock()  # //Data-Shapes
code_block_2 = CodeBlock()  # //archilab
code_block_3 = CodeBlock { "Ajuste da Topografia ao Piso"; }
file_path = Filename("..\..\..\..\..\05 - BIMACON\01 - EMPRESA BIMACON\00 - Logos e imagens - BIMACON\ARTE BIMACON\reddonda-removebg-preview.png")
file_from_path = FileObject(path=file_path)
readFromFile = Image.ReadFromFile(file=file_from_path)
string = StringInput("Confirmar")
string_2 = StringInput("Subregião (deverá ter o mesmo contorno do piso)")
string_3 = StringInput("Selecione ")
categories = Categories("OST_BuildingPad")
categories_2 = Categories("OST_Topography")
categories_3 = Categories("OST_Toposolid")
list_create = List.Create(item0=categories, item1=categories_2, item2=categories_3)
boolean = BoolSelector(true)
selectmodelelements_data = Custom[SelectModelElements Data](InputName=string_2, ButtonText=string_3, CategoryFilter=list_create, SelectSingleElement=boolean)  # package Data-Shapes; Creates a Revit element selection input for UI.MultipleInputForm++ . Check out www.data-shapes.net for more infos!
string_4 = StringInput("Linhas do piso (edges)")
selectedges_data = Custom[SelectEdges Data](InputName=string_4)  # package Data-Shapes; Creates a Revit edge selection input for UI.MultipleInputForm++ . Check out www.data-shapes.net for more infos!
string_5 = StringInput("Altura de deslocamento da topografia a partir das linhas do piso")
string_6 = StringInput("0")
boolean_2 = BoolSelector(true)
textbox_data = Custom[TextBox Data](InputName=string_5, DefaultText=string_6, IsNumberEntry=boolean_2)  # package Data-Shapes; Create Data for TextBox input in UI.MultipleInputForm ++ . Check out www.data-shapes.net for more informations
string_7 = StringInput("Espaçamento entre pontos que serão adicionados")
string_8 = StringInput("0.5")
boolean_3 = BoolSelector(true)
textbox_data_2 = Custom[TextBox Data](InputName=string_7, DefaultText=string_8, IsNumberEntry=boolean_3)
string_9 = StringInput("Range de pontos próximos à serem limpos (suavização da topografia)")
string_10 = StringInput("1")
boolean_4 = BoolSelector(true)
textbox_data_3 = Custom[TextBox Data](InputName=string_9, DefaultText=string_10, IsNumberEntry=boolean_4)
list_create_2 = List.Create(item0=selectmodelelements_data, item1=selectedges_data, item2=textbox_data, item3=textbox_data_2, item4=textbox_data_3)
boolean_5 = BoolSelector(true)
string_11 = StringInput("Cancelar")
number = DoubleInput(600)
number_2 = DoubleInput(280)
multipleinputform = Custom[MultipleInputForm ++](Description_optional=code_block_3, Logo_optional=readFromFile, ButtonText_optional=string, Inputs=list_create_2, Toggle=boolean_5, CancelButtonText_optional=string_11, Width_optional=number, LabelWidth_optional=number_2)  # package Data-Shapes; Create a form with multiple inputs. see www.data-shapes.net for tutorials and infos!

code_block_4 = CodeBlock { 4; }
getItemAtIndex = List.GetItemAtIndex(list=multipleinputform.User_Inputs, index=code_block_4)
code_block_5 = CodeBlock { 3; }
getItemAtIndex_2 = List.GetItemAtIndex(list=multipleinputform.User_Inputs, index=code_block_5)

# group: Separar Entradas
code_block_6 = CodeBlock { 0; }
getItemAtIndex_3 = List.GetItemAtIndex(list=multipleinputform.User_Inputs, index=code_block_6)
code_block_7 = CodeBlock { 2; }
getItemAtIndex_4 = List.GetItemAtIndex(list=multipleinputform.User_Inputs, index=code_block_7)
code_block_8 = CodeBlock { 1; }
getItemAtIndex_5 = List.GetItemAtIndex(list=multipleinputform.User_Inputs, index=code_block_8)

select_topography_from_subregion = Custom[Select Topography From Subregion](VARTopography=getItemAtIndex_3)  # package Synthesize toolkit; Select Topography From Subregion
topography_auto_k_align_data = Custom[Topography Auto K-Align Data Prepare](VARNearbyPointsCleaningRange=getItemAtIndex, VARSpacingBetweenPointsToAdd=getItemAtIndex_2, VARTopography=select_topography_from_subregion, VARHeightOffsetOfSelectedEdges=getItemAtIndex_4, VAREdges=getItemAtIndex_5)  # package Synthesize toolkit; Topography Auto K-Align Data Prepare
python_script = Python(IN[0]=topography_auto_k_align_data.VARPointsToAdd, IN[1]=select_topography_from_subregion, IN[2]=topography_auto_k_align_data.VARMinPoints, IN[3]=topography_auto_k_align_data.VARMaxPoints, IN[4]=getItemAtIndex, IN[5]=topography_auto_k_align_data.VARPointsToAdd)
# ---------- python_script.python (120 lines) ----------
# Created By Karam Baki : karam@aecedx.com
# Enable Python support and load DesignScript library
# IMPORTANT : ALL DYNAMO DESIGN SCRIPT NODES ARE AS (dg)
import clr
clr.AddReference('ProtoGeometry')
from Autodesk.DesignScript import Geometry as dg

# EXTENSION Enable ToDSType
clr.AddReference('RevitNodes')
import Revit
clr.ImportExtensions(Revit.Elements)

# Enable Revit Elements
from Revit.Elements import *

# EXTENSION Enable Geometry Conversion Methods
clr.ImportExtensions(Revit.GeometryConversion)

# Enable Revit API
clr.AddReference('RevitAPI')
from Autodesk.Revit.DB import *
import Autodesk.Revit.DB
# Enable DocumentManager and TransactionManager
clr.AddReference('RevitServices')
from RevitServices.Persistence import DocumentManager
from RevitServices.Transactions import TransactionManager

# Enable ICollection List Translate
clr.AddReference("System")
import System.Collections.Generic
from System.Collections.Generic import List
doc = DocumentManager.Instance.CurrentDBDocument
uidoc = DocumentManager.Instance.CurrentUIApplication.ActiveUIDocument
uiapp = DocumentManager.Instance.CurrentUIApplication
app = uiapp.Application

class WarnSwallow(IFailuresPreprocessor):
	def PreprocessFailures(self, failuresAccessor):
		failuresAccessor.DeleteAllWarnings()
		return FailureProcessingResult.Continue

dataEnteringNode = IN
# Use UnwrapElement(IN[0]) When Translating From Dynamo to Revit
points = UnwrapElement(IN[0])
topo = UnwrapElement(IN[1])
minp = UnwrapElement(IN[2])
maxp = UnwrapElement(IN[3])
range = IN[4]
goodpts = UnwrapElement(IN[5])

if range > 0:

	count = 0
	bboxes = []
	for each in minp:
		bboxes.append(dg.BoundingBox.ByCorners(each, maxp[count]))
		count = count + 1

	allpts = topo.GetPoints()
	convpts = []
	for each in allpts:
		convpts.append(each.ToPoint())

	todelpts = []
	for eachbox in bboxes:
		for e in convpts:
			if dg.BoundingBox.Contains(eachbox,e):
				todelpts.append(e)
	uniquetodelpts = set(todelpts)
	todelpts = list(uniquetodelpts)

	todelxyz = []
	for e in todelpts:
		todelxyz.append(e.ToXyz())

	#Disposing Stuff
	for e in convpts:
		e.Dispose()

xyzconvgood = []
for each in goodpts:
	try:
		xyzconvgood.append(each.ToXyz())
	except:
		pass

failproc = WarnSwallow()
ilistofidsgood = List[Autodesk.Revit.DB.XYZ](xyzconvgood)
if range > 0:
	if len(todelxyz) > 0:
		ilistofids = List[Autodesk.Revit.DB.XYZ](todelxyz)
editsession = Architecture.TopographyEditScope(doc,"Topo K-Align")
editsessioncl = Architecture.TopographyEditScope(doc,"Topo Clean Up")

if range > 0:
	try:
		if len(todelxyz) > 0:
			Revit.Transaction.Transaction.End(doc)
			editsessioncl.Start(topo.Id)
			TransactionManager.Instance.EnsureInTransaction(doc)
			topo.DeletePoints(ilistofids)
			TransactionManager.Instance.ForceCloseTransaction()
			editsessioncl.Commit(failproc)
	except:
		pass
	Revit.Transaction.Transaction.End(doc)
	editsession.Start(topo.Id)
	TransactionManager.Instance.EnsureInTransaction(doc)
	topo.AddPoints(ilistofidsgood)
	TransactionManager.Instance.ForceCloseTransaction()
	editsession.Commit(failproc)
else:
	Revit.Transaction.Transaction.End(doc)
	editsession.Start(topo.Id)
	TransactionManager.Instance.EnsureInTransaction(doc)
	topo.AddPoints(ilistofidsgood)
	TransactionManager.Instance.ForceCloseTransaction()
	editsession.Commit(failproc)

OUT = topo
# ----------------------------------------

# group: Mensagem Final
flatten = List.Flatten(list=python_script)
count = List.Count(list=flatten)
code_block_9 = CodeBlock { 0; }
gt = count > code_block_9
code_block_10 = CodeBlock { ["Feito! você anexou a topografia junto ao piso"]; }
code_block_11 = CodeBlock { ["Nenhuma topografia foi anexado ao piso"]; }
if_ = If(test=gt, true=code_block_10, false=code_block_11)
flatten_2 = List.Flatten(list=if_)

string_fromlist_bimacon = Python(IN[0]=flatten_2)
# ---------- string_fromlist_bimacon.python (22 lines) ----------
# Carregar as bibliotecas DesignScript e padrão do Python
import sys
import clr
clr.AddReference('ProtoGeometry')
from Autodesk.DesignScript.Geometry import *

# Função para concatenar os valores de uma lista em uma única string com múltiplas linhas
def concatenate_list_to_string(input_list, delimiter="\n"):
    # Verifica se a entrada é uma lista
    if not isinstance(input_list, list):
        return "A entrada deve ser uma lista."
    
    # Converte todos os elementos para string e junta com o delimitador especificado
    result = delimiter.join(str(item) for item in input_list)
    return result

# Entrada pelo nó do Dynamo
lista = IN[0]  # Lista de valores a serem concatenados
delimitador = IN[1] if len(IN) > 1 else "\n"  # Delimitador opcional, padrão é nova linha

# Saída para o Dynamo
OUT = concatenate_list_to_string(lista, delimitador)
# ----------------------------------------

# group (continued): Mensagem Final
python_script_2 = Python(IN[0]=string_fromlist_bimacon)
# ---------- python_script_2.python (21 lines) ----------
# Importar as bibliotecas necessárias do Revit
import clr
clr.AddReference("RevitServices")
from RevitServices.Persistence import DocumentManager

clr.AddReference("RevitAPI")
clr.AddReference("RevitAPIUI")
from Autodesk.Revit.UI import TaskDialog

# Pegar a entrada do Dynamo
mensagem = IN[0]

# Criar a TaskDialog
task_dialog = TaskDialog("Ok")
task_dialog.MainInstruction = mensagem

# Exibir a TaskDialog
task_dialog.Show()

# Saída do script
OUT = "Sucesso!"
# ----------------------------------------
