# Dynamo graph BIMACON_VERGAS EM PORTAS_script.dyn (Dynamo 2.19.3.6394)
# packages: Clockwork for Dynamo 2.x 2.4.0, Data-Shapes 2022.2.105, DynaMEP 2.0.1, Synthesize toolkit 12.5.1

categories = Categories("OST_Doors")

# group: ENTRADAS PARA O USUÁRIO
code_block = CodeBlock { "Inserção de Vergas em Portas"; }
file_path = Filename("..\..\..\..\..\05 - BIMACON\01 - EMPRESA BIMACON\00 - Logos e imagens - BIMACON\ARTE BIMACON\reddonda-removebg-preview.png")
file_from_path = FileObject(path=file_path)
readFromFile = Image.ReadFromFile(file=file_from_path)
string = StringInput("Confirmar")
string_2 = StringInput("Selecione o Tipo de Viga")
categories_2 = Categories("OST_StructuralFraming")
all_family_types_of_category = Custom[All Family Types Of Category](category=categories_2)  # package Clockwork for Dynamo 2.x; Gets all family types/symbols of a given category in the model.
family = FamilyType.Family(familyType=all_family_types_of_category)
name = Family.Name(family=family)
code_block_2 = CodeBlock { " - "; }
add = name + code_block_2
name_2 = Element.Name(element=all_family_types_of_category)
add_2 = add + name_2
code_block_3 = CodeBlock { 0; }
dropdown_data = Custom[DropDown Data](InputName=string_2, Keys=add_2, Values=all_family_types_of_category, DefaultValueIndex=code_block_3)  # package Data-Shapes; Create data for DropDown input in UI.MultiInputForm ++ . Check out www.data-shapes.net for more infos.
string_3 = StringInput("Comprimento do Apoio")
string_4 = StringInput("0.3")
boolean = BoolSelector(true)
textbox_data = Custom[TextBox Data](InputName=string_3, DefaultText=string_4, IsNumberEntry=boolean)  # package Data-Shapes; Create Data for TextBox input in UI.MultipleInputForm ++ . Check out www.data-shapes.net for more informations
string_5 = StringInput("Selecione o Nível")
element_types = ElementTypes("Level")
all_elements_of_type = ElementsOfType(element_class=element_types)
name_3 = Level.Name(level=all_elements_of_type)
code_block_4 = CodeBlock { 0; }
dropdown_data_2 = Custom[DropDown Data](InputName=string_5, Keys=name_3, Values=all_elements_of_type, DefaultValueIndex=code_block_4)
string_6 = StringInput("Selecione a Fase")
element_types_2 = ElementTypes("Phase")
all_elements_of_type_2 = ElementsOfType(element_class=element_types_2)
name_4 = Level.Name(level=all_elements_of_type_2)
code_block_5 = CodeBlock { 1; }
dropdown_data_3 = Custom[DropDown Data](InputName=string_6, Keys=name_4, Values=all_elements_of_type_2, DefaultValueIndex=code_block_5)
list_create = List.Create(item0=dropdown_data, item1=textbox_data, item2=dropdown_data_2, item3=dropdown_data_3)
boolean_2 = BoolSelector(true)
string_7 = StringInput("Cancelar")
number = DoubleInput(600)
number_2 = DoubleInput(180)
multipleinputform = Custom[MultipleInputForm ++](Description_optional=code_block, Logo_optional=readFromFile, ButtonText_optional=string, Inputs=list_create, Toggle=boolean_2, CancelButtonText_optional=string_7, Width_optional=number, LabelWidth_optional=number_2)  # package Data-Shapes; Create a form with multiple inputs. see www.data-shapes.net for tutorials and infos!
code_block_6 = CodeBlock()  # //archilab
code_block_7 = CodeBlock()  # //Data-Shapes

# group: Separar Entradas
code_block_8 = CodeBlock { 0; }
getItemAtIndex = List.GetItemAtIndex(list=multipleinputform.User_Inputs, index=code_block_8)
code_block_9 = CodeBlock { 3; }
getItemAtIndex_2 = List.GetItemAtIndex(list=multipleinputform.User_Inputs, index=code_block_9)
code_block_10 = CodeBlock { 1; }
getItemAtIndex_3 = List.GetItemAtIndex(list=multipleinputform.User_Inputs, index=code_block_10)
code_block_11 = CodeBlock { 2; }
getItemAtIndex_4 = List.GetItemAtIndex(list=multipleinputform.User_Inputs, index=code_block_11)

passthrough = Custom[Passthrough](passThrough=categories, waitFor=getItemAtIndex)  # package Clockwork for Dynamo 2.x; Forces a sequential order of execution. The node wired into the output of the Passthrough node will be executed *after* the node wired into the waitFor input (e.g. important for some Revit operations). The value of the passThrough input will be passed on to the node wired into the output port of the Passthrough node.
all_elements_of_category = ElementsOfCategory(Category=passthrough)
filterByPhaseCreated = RevitModel.Element.FilterByPhaseCreated(element=all_elements_of_category, phase=getItemAtIndex_2)
getHost = FamilyInstance.GetHost(familyInstance=filterByPhaseCreated)
isNull = Object.IsNull(object=getHost)
filterByBoolMask = List.FilterByBoolMask(list=filterByPhaseCreated, mask=isNull)
getLocation = Element.GetLocation(element=filterByBoolMask.out)
code_block_12 = CodeBlock { "Altura da extremidade"; }
getParameterValueByName = Element.GetParameterValueByName(element=filterByBoolMask.out, parameterName=code_block_12)
translate = Geometry.Translate(geometry=getLocation, zTranslation=getParameterValueByName)
boolean_3 = BoolSelector(false)
clean = List.Clean(list=getHost, preserveIndices=boolean_3)
getLocation_2 = Element.GetLocation(element=clean)
direction = Line.Direction(line=getLocation_2)
elementType = Element.ElementType(element=filterByBoolMask.out)
code_block_13 = CodeBlock { "Largura"; }
getParameterValueByName_2 = Element.GetParameterValueByName(element=elementType, parameterName=code_block_13)
code_block_14 = CodeBlock(a=getParameterValueByName_2) { a/2; }
byStartPointDirectionLength = Line.ByStartPointDirectionLength(startPoint=translate, direction=direction, length=code_block_14)
extendStart = Curve.ExtendStart(curve=byStartPointDirectionLength, distance=code_block_14)
extendEnd = Curve.ExtendEnd(curve=extendStart, distance=getItemAtIndex_3)
extendStart_2 = Curve.ExtendStart(curve=extendEnd, distance=getItemAtIndex_3)
beamByCurve = StructuralFraming.BeamByCurve(curve=extendStart_2, level=getItemAtIndex_4, structuralFramingType=getItemAtIndex)
code_block_15 = CodeBlock { "Justificação z"; }
code_block_16 = CodeBlock { 3; }
setParameterByName = Element.SetParameterByName(element=beamByCurve, parameterName=code_block_15, value=code_block_16)

# group: Mensagem final
isNull_2 = Object.IsNull(object=setParameterByName)
code_block_17 = CodeBlock { ["Nenhuma Verga foi inserida"]; }
count = List.Count(list=setParameterByName)
code_block_18 = CodeBlock(N=count) { ["Feito! Você inseriu "+N+" Vergas em seu projeto"]; }
if_ = If(test=isNull_2, true=code_block_17, false=code_block_18)
flatten = List.Flatten(list=if_)

string_fromlist_bimacon = Python(IN[0]=flatten)  # IronPython2
# ---------- string_fromlist_bimacon.python (22 lines) ----------
# Carregar as bibliotecas DesignScript e padrão do Python
import sys
import clr
clr.AddReference('ProtoGeometry')
from Autodesk.DesignScript.Geometry import *

# Função para concatenar os valores de uma lista em uma única string com múltiplas linhas
def concatenate_list_to_string(input_list, delimiter="\n"):
    # Verifica se a entrada é uma lista
    if not isinstance(input_list, list):
        return "A entrada deve ser uma lista."
    
    # Converte todos os elementos para string e junta com o delimitador especificado
    result = delimiter.join(str(item) for item in input_list)
    return result

# Entrada pelo nó do Dynamo
lista = IN[0]  # Lista de valores a serem concatenados
delimitador = IN[1] if len(IN) > 1 else "\n"  # Delimitador opcional, padrão é nova linha

# Saída para o Dynamo
OUT = concatenate_list_to_string(lista, delimitador)
# ----------------------------------------

# group (continued): Mensagem final
python_script = Python(IN[0]=string_fromlist_bimacon)  # IronPython2
# ---------- python_script.python (21 lines) ----------
# Importar as bibliotecas necessárias do Revit
import clr
clr.AddReference("RevitServices")
from RevitServices.Persistence import DocumentManager

clr.AddReference("RevitAPI")
clr.AddReference("RevitAPIUI")
from Autodesk.Revit.UI import TaskDialog

# Pegar a entrada do Dynamo
mensagem = IN[0]

# Criar a TaskDialog
task_dialog = TaskDialog("Ok")
task_dialog.MainInstruction = mensagem

# Exibir a TaskDialog
task_dialog.Show()

# Saída do script
OUT = "Sucesso!"
# ----------------------------------------

phase = Custom[BVN.View.Phase]()  # package Synthesize toolkit; Returns the current view's phase
phases = Custom[Document.Phases]()  # package Clockwork for Dynamo 2.x; Retrieves all phases in the active document in *chronological* order
