# Dynamo graph Abrir link navegador_Telegram_script.dyn "Abrir link navegador_Telegram" (Dynamo 2.6.1.8786)
# packages: Crumple 2021.9.24

string = StringInput("https://t.me/+xrcBLwpB8QE1ZmRh")
boolean = BoolSelector(true)
openurl = Custom[© OpenURL](url=string, runMe=boolean)  # package Crumple; Given a URL, will attempt to open in the default web browser used by Windows.
watch = Watch(openurl)
