# Dynamo graph Abrir link navegador_Youtube_script.dyn "Abrir link navegador_Youtube" (Dynamo 2.6.1.8786)
# packages: Crumple 2021.9.24

string = StringInput("https://www.youtube.com/channel/UC98gcgEl3JU-vywZATtl8mA?sub_confirmation=1")
boolean = BoolSelector(true)
openurl = Custom[© OpenURL](url=string, runMe=boolean)  # package Crumple; Given a URL, will attempt to open in the default web browser used by Windows.
watch = Watch(openurl)
