# Dynamo graph ok BIMACON_Atribuir Código em Portas Janelas_R01_script.dyn (Dynamo 2.6.1.8786)
# Inseri Identificadores nas conexões
# packages: Data-Shapes 2022.2.105, DynaMEP 2.0.1

categories = Categories("OST_Doors")
categories_2 = Categories("OST_Windows")
list_create = List.Create(item0=categories, item1=categories_2)
all_elements_of_category = ElementsOfCategory(Category=list_create)

# group: Janela de Imputs
string = StringInput("Inserir Identificadores em conexões")
file_path = Filename("C:\Users\jneng\Documents\logo.png")
file_from_path = FileObject(path=file_path)
readFromFile = Image.ReadFromFile(file=file_from_path)
string_2 = StringInput("Executar")
string_3 = StringInput("Selecione a Fase")
code_block = CodeBlock { "Existente"; "Nova Construção"; "Reforma"; }
list_create_2 = List.Create(item0=code_block.out0, item1=code_block.out1, item2=code_block.out2)
select_phase = RevitPhases("Existente")
select_phase_2 = RevitPhases("Nova Construcão")
select_phase_3 = RevitPhases("Reforma")
list_create_3 = List.Create(item0=select_phase, item1=select_phase_2, item2=select_phase_3)
number = DoubleInput(1)
dropdown_data = Custom[DropDown Data](InputName=string_3, Keys=list_create_2, Values=list_create_3, DefaultValueIndex=number)  # package Data-Shapes; Create data for DropDown input in UI.MultiInputForm ++ . Check out www.data-shapes.net for more infos.
string_4 = StringInput("Selecione a Categoria")
code_block_2 = CodeBlock { "Portas"; "Janelas"; }
list_create_4 = List.Create(item0=code_block_2.out0, item1=code_block_2.out1)
number_2 = DoubleInput(0)
dropdown_data_2 = Custom[DropDown Data](InputName=string_4, Keys=list_create_4, Values=list_create_4, DefaultValueIndex=number_2)
string_5 = StringInput("Indique o Prefixo. Ex: \"P\" ou \"J\"")
string_6 = StringInput("P")
boolean = BoolSelector(false)
textbox_data = Custom[TextBox Data](InputName=string_5, DefaultText=string_6, IsNumberEntry=boolean)  # package Data-Shapes; Create Data for TextBox input in UI.MultipleInputForm ++ . Check out www.data-shapes.net for more informations
list_create_5 = List.Create(item0=dropdown_data, item1=dropdown_data_2, item2=textbox_data)
boolean_2 = BoolSelector(true)
string_7 = StringInput("http://bimacon.wix.com/bimacon")
string_8 = StringInput("Cancelar")
number_3 = DoubleInput(500)
number_4 = DoubleInput(220)
multipleinputform = Custom[MultipleInputForm ++](Description_optional=string, Logo_optional=readFromFile, ButtonText_optional=string_2, Inputs=list_create_5, Toggle=boolean_2, LinkToHelp_optional=string_7, CancelButtonText_optional=string_8, Width_optional=number_3, LabelWidth_optional=number_4)  # package Data-Shapes; Create a form with multiple inputs. see www.data-shapes.net for tutorials and infos!

code_block_3 = CodeBlock(IN=multipleinputform.User_Inputs) { texto1 = IN[0]; texto2 = IN[1]; texto3 = IN[2]; }
filterByPhaseCreated = RevitModel.Element.FilterByPhaseCreated(element=all_elements_of_category@L2, phase=code_block_3.texto1)
elementType = Element.ElementType(element=filterByPhaseCreated)
getCategory = Element.GetCategory(element=elementType)
string_from_object = FromObject(object=getCategory)
contains = String.Contains(str=string_from_object, searchFor=code_block_3.texto2)
filterByBoolMask = List.FilterByBoolMask(list=elementType, mask=contains)
flatten = List.Flatten(list=filterByBoolMask.in)
name = Family.Name(family=flatten)
string_9 = StringInput("Peitoril")
boolean_3 = BoolSelector(true)
contains_2 = String.Contains(str=name, searchFor=string_9, ignoreCase=boolean_3)
filterByBoolMask_2 = List.FilterByBoolMask(list=flatten, mask=contains_2)
name_2 = Family.Name(family=filterByBoolMask_2.out)
string_10 = StringInput("Soleira")
contains_3 = String.Contains(str=name_2, searchFor=string_10, ignoreCase=boolean_3)
filterByBoolMask_3 = List.FilterByBoolMask(list=filterByBoolMask_2.out, mask=contains_3)
familyName = ElementType.FamilyName(elementType=filterByBoolMask_3.out)
name_3 = Family.Name(family=filterByBoolMask_3.out)
code_block_4 = CodeBlock(nomedaFamilia=familyName, nomedoTipo=name_3) { nomedaFamilia +": " + nomedoTipo; }
sortByKey = List.SortByKey(list=filterByBoolMask_3.out@L2, keys=code_block_4@L2)
groupByKey = List.GroupByKey(list=sortByKey.sorted_list@L2, keys=sortByKey.sorted_keys@L2)
firstItem = List.FirstItem(list=groupByKey.groups@L2)
string_11 = StringInput("Marca de tipo")
number_5 = DoubleInput(1)
count = List.Count(list=firstItem)
range = Range(start=number_5, end=count)
number_6 = DoubleInput(10)
lt = range < number_6
string_12 = StringInput("0")
add = string_12 + range
string_13 = StringInput("")
add_2 = string_13 + range
condição_if_de_lista = CodeBlock(test=lt, verd=add, fals=add_2)
# ---------- condição_if_de_lista.designscript (3 lines) ----------
//Condições IF
indx = (test) ? 0 : 1;
rslt = [verd,fals][indx];
# ----------------------------------------
concat = String.Concat(string0=code_block_3.texto3)  # unwired: string1
map = List.Map(list=condição_if_de_lista.rslt, f_x=concat)
setParameterByName = Element.SetParameterByName(element=firstItem, parameterName=string_11, value=map)
